# Grasshopper definition external-gh.gh (Grasshopper 1.0.7)
# plug-ins: Hops

gh_file_from_drive_raw = Panel("https://drive.google.com/uc?export=download&id=1G67QvOYHbMOG1WThkTdz6tMmMvtJNveA")
gh_file_from_github = Panel("https://github.com/davleon-mod/intro-compute/raw/main/hops/rnd_node.gh")
panel = Panel("https://stackoverflow.com/questions/24834877/google-drive-raw-data")
hops = Hops(
    _Path=gh_file_from_drive_raw,
    Radius=12,
    Count=12,
    CacheResultsInMemory=True,
    CacheSolveResults=True,
    RemoteDefinitionLocation="https://drive.google.com/uc?export=download&id=1G67QvOYHbMOG1WThkTdz6tMmMvtJNveA",
    RemoteSolveVersion=(0, 1, 0),
    ShowInput_Enabled=False,
    ShowInput_Path=True,
    SynchronousSolve=True)  # -> Edges, Mesh
hops_2 = Hops(
    _Path=gh_file_from_github,
    Radius=12,
    Count=12,
    CacheResultsInMemory=True,
    CacheSolveResults=True,
    RemoteDefinitionLocation="https://github.com/davleon-mod/intro-compute/raw/main/hops/rnd_node.gh",
    RemoteSolveVersion=(0, 1, 0),
    ShowInput_Enabled=False,
    ShowInput_Path=True,
    SynchronousSolve=True)  # -> Edges, Mesh
