# Grasshopper definition rnd_node.gh (Grasshopper 1.0.7)
# plug-ins: Kangaroo2 Components

radius = Slider(13, range=5..20)
count = Slider(14, range=2..20)
sph = Sphere(Base=PlaneXY(0, 0, 0), Radius=radius)
pt = ConstructPoint(XCoordinate=0, YCoordinate=0, ZCoordinate=0)
popgeo = PopulateGeometry(Geometry=sph, Count=count, Seed=1)
division = Division(A=radius, B=count)
ln = Line(StartPoint=pt, EndPoint=popgeo)
mp = MultiPipe(Curves=ln, NodeSize=division, EndOffset=1, StrutSize=1, Segment=0, KinkAngle=0.6, CubeFit=0)
meshsubd = MeshFromSubD(SubD=mp, Density=Slider(1, range=0..1))
clean = CombineClean(Meshes=meshsubd)
medges = MeshEdges(Mesh=clean)  # -> NakedEdges, InteriorEdges, NonManifoldEdges

# ---- group: mesh
mesh = Mesh(clean)

# ---- group: edges
crv = Curve([medges.NakedEdges, medges.InteriorEdges])

# ----
preview = CustomPreview(Geometry=mesh, Material=ColourSwatch(SwatchColor=RGB(209, 165, 165)))
preview_2 = CustomPreview(Geometry=crv, Material=ColourSwatch(SwatchColor=RGB(0, 0, 0)))
