# Grasshopper definition rnd_node_hops.gh (Grasshopper 1.0.7)
# plug-ins: Kangaroo2 Components

radius = Slider(12, range=5..20)
count = Slider(12, range=2..20)
radius_2 = GetNumber(radius, AtLeast=1, AtMost=1, Maximum=1.797693135e+308, Minimum=-1.797693135e+308, TreeAccess=False)
count_2 = GetNumber(count, AtLeast=1, AtMost=1, Maximum=1.797693135e+308, Minimum=-1.797693135e+308, TreeAccess=False)
sph = Sphere(Base=PlaneXY(0, 0, 0), Radius=radius_2)
pt = ConstructPoint(XCoordinate=0, YCoordinate=0, ZCoordinate=0)
popgeo = PopulateGeometry(Geometry=sph, Count=count_2, Seed=1)
division = Division(A=radius_2, B=count_2)
ln = Line(StartPoint=pt, EndPoint=popgeo)
mp = MultiPipe(Curves=ln, NodeSize=division, EndOffset=1, StrutSize=1, Segment=0, KinkAngle=0.6, CubeFit=0)
meshsubd = MeshFromSubD(SubD=mp, Density=Slider(1, range=0..1))
clean = CombineClean(Meshes=meshsubd)
medges = MeshEdges(Mesh=clean)  # -> NakedEdges, InteriorEdges, NonManifoldEdges

# ---- group: convert lines to curves
crv = Curve([medges.NakedEdges, medges.InteriorEdges])

# ----
mesh = Mesh(clean)
context_bake = ContextBake(Geometry=crv)
context_bake_2 = ContextBake(Geometry=mesh)
preview = CustomPreview(Geometry=crv, Material=ColourSwatch(SwatchColor=RGB(0, 0, 0)))
preview_2 = CustomPreview(Geometry=mesh, Material=ColourSwatch(SwatchColor=RGB(209, 165, 165)))
